# Grasshopper definition Speckle_AECTech.ghx (Grasshopper 1.0.7)
# plug-ins: Speckle 2

# ---- group: Column sliders
random_seed = Slider(3, range=0..10)
number_of_columns = Slider(8, range=0..10)
column_radius = Slider(0.3, range=0..1)

# ---- group: Canopy pattern sliders
number_of_generators = Slider(10, range=4..15)
random_seed_2 = Slider(4, range=0..10)

# ---- group: Input nurbs surface
srf = Surface(<surface referenced from the Rhino model>)

# ----
edges = BrepEdges(Brep=srf)  # -> Naked, Interior, NonManifold
cluster = Cluster(S=srf, G=srf, B_2=number_of_generators, S_2=random_seed_2)  # -> B, L
edges_2 = BrepEdges(Brep=cluster.B)  # -> Naked, Interior, NonManifold
geo = Geometry(cluster.L)
cluster_2 = Cluster_2(L=edges_2.Naked, P=geo, B=geo, B_3=srf, L_2=edges_2.Naked, P_2=geo, B_4=srf, B_2=geo)  # -> C, C_2
cluster_3 = Cluster_3(A=cluster_2.C, B=cluster_2.C_2, S=random_seed, B_2=number_of_columns, R=column_radius)
geo_2 = Geometry(flatten([edges.Naked, cluster_2.C, cluster_2.C_2]))
pipe = Pipe(Curve=geo_2, Radius=Slider(0.2, range=0..1), Caps=0)
cluster_4 = Cluster_4(B=geo_2, F=Slider(1.3, range=0..10), B_2=Slider(0.1, range=0..1))

# ---- group: BEAMS
branch_url = Panel("[your beam - option 1 branch url]")
branch_url_2 = Panel("[your beam - option 2 branch url]")
geo_3 = Geometry(pipe)
geo_4 = Geometry(cluster_4)
send = Send(
    Data=geo_4,
    Stream=branch_url_2,
    AutoSend=False,
    BaseId="e45cccbbcbf67117deecf36cc42b216a",
    CurrentComponentState="expired",
    KitName="Objects",
    OutputWrappers="https://speckle.xyz\tb225bb069c\tbff4942233",
    UseDefaultCache=True)
send_2 = Send(
    Data=geo_3,
    Stream=branch_url,
    AutoSend=False,
    BaseId="9938a68bb6515de3a94d6d859f40a657",
    CurrentComponentState="expired",
    KitName="Objects",
    OutputWrappers="https://speckle.xyz\tb225bb069c\t4bd0947096",
    UseDefaultCache=True)

# ----
# Branch URL: [your column - option 2 branch url]
branch_url_3 = Panel("[your column - option 1 branch url]")
geo_5 = Geometry(cluster_3)
send_3 = Send(
    Data=geo_5,
    Stream=branch_url_3,
    AutoSend=False,
    BaseId="ff415bbf9fcd0e28e4e432986b09b6ba",
    CurrentComponentState="expired",
    KitName="Objects",
    OutputWrappers="https://speckle.xyz\tb225bb069c\t12c6768ac4",
    UseDefaultCache=True)

# ---- group: CANOPY SURFACE
stream_url = Panel("[your stream url]")
send_4 = Send(
    Data=srf,
    Stream=stream_url,
    AutoSend=False,
    BaseId="5da7d8a8458802598a70eec3be16f2be",
    CurrentComponentState="expired",
    KitName="Objects",
    OutputWrappers="https://speckle.xyz\tb225bb069c\t30344f055f",
    UseDefaultCache=True)

# ==== cluster Cluster
S = ClusterInput()
G = ClusterInput()
srfpt = SurfacePoints(Surface=S)  # -> Points, Weights, Greville, UCount, VCount
project = Project(Geometry=G, Plane=PlaneXY(0, 0, 0))  # -> Geometry, Transform
project_2 = Project(Geometry=srfpt.Points, Plane=PlaneXY(0, 0, 0))  # -> Geometry, Transform
bbox = BoundingBox(Content=project.Geometry, Plane=PlaneXY(0, 0, 0))  # -> Box, Box_2
edges = BrepEdges(Brep=project.Geometry)  # -> Naked, Interior, NonManifold
join = JoinCurves(Curves=edges.Naked, Preserve=False)
offset = OffsetCurve(Curve=join, Distance=Slider(3, range=0..10), Plane=PlaneXY(0, 0, 0), Corners=1)
B = ClusterOutput(bbox.Box)
incurve = PointInCurve(Point=project_2.Geometry, Curve=offset)  # -> Relationship, Point
equals = Equality(FirstNumber=incurve.Relationship, SecondNumber=2)  # -> Equality, Inequality
B_2 = ClusterInput()
S_2 = ClusterInput()
cull = CullPattern(List=project_2.Geometry, CullPattern=equals.Equality)
lng = ListLength(List=cull)
subtraction = Subtraction(A=lng, B=B_2)
reduce = RandomReduce(List=cull, Reduction=subtraction, Seed=S_2)
L = ClusterOutput(reduce)

# ==== cluster Cluster_2
L = ClusterInput()
P = ClusterInput()
B = ClusterInput()
L_2 = ClusterInput()
P_2 = ClusterInput()
B_2 = ClusterInput()
item = ListItem(List=L, Index=0, Wrap=True)
crv_cp = CurveClosestPoint(Point=P, Curve=item)  # -> simplify(graft(Point)), Parameter, Distance
vec2pt = Vector2Pt(PointA=crv_cp.Point, PointB=simplify(graft(B)), Unitize=False)  # -> Vector, Length
item_2 = ListItem(List=L_2, Index=1, Wrap=True)
crv_cp_2 = CurveClosestPoint(Point=P_2, Curve=item_2)  # -> simplify(graft(Point)), Parameter, Distance
vec2pt_2 = Vector2Pt(PointA=crv_cp_2.Point, PointB=simplify(graft(B_2)), Unitize=False)  # -> Vector, Length
move = Move(Geometry=item_2, Motion=vec2pt_2.Vector)  # -> Geometry, Transform
move_2 = Move(Geometry=item, Motion=vec2pt.Vector)  # -> simplify(Geometry), Transform
move_3 = Move(Geometry=item_2, Motion=vec2pt_2.Vector)  # -> simplify(Geometry), Transform
B_3 = ClusterInput()
B_4 = ClusterInput()
project = Project(Curve=move_2.Geometry, Brep=B_3, Direction=Vector(0, 0, 1))
project_2 = Project(Curve=move_3.Geometry, Brep=B_4, Direction=Vector(0, 0, 1))
C = ClusterOutput(project)
C_2 = ClusterOutput(project_2)

# ==== cluster Cluster_3
A = ClusterInput()
B = ClusterInput()
ccx = CurveCurve(CurveA=A, CurveB=flatten(B))  # -> flatten(Points), ParamsA, ParamsB
B_2 = ClusterInput()
cset = CreateSet(List=ccx.Points)  # -> Set, Map
lng = ListLength(List=cset.Set)
subtraction = Subtraction(A=lng, B=B_2)
S = ClusterInput()
reduce = RandomReduce(List=cset.Set, Reduction=subtraction, Seed=S)
project = Project(Geometry=reduce, Plane=PlaneXY(0, 0, 0))  # -> Geometry, Transform
R = ClusterInput()
ln = Line(StartPoint=reduce, EndPoint=project.Geometry)
pipe = Pipe(Curve=ln, Radius=R, Caps=0)
P = ClusterOutput(pipe)

# ==== cluster Cluster_4
F = ClusterInput()
B = ClusterInput()
B_2 = ClusterInput()
Z = UnitZ(Factor=F)
extr = Extrude(Base=B, Direction=Z)
planar = IsPlanar(Surface=extr, Interior=True)  # -> Planar, Plane
deplane = DeconstructPlane(Plane=planar.Plane)  # -> Origin, XAxis, YAxis, ZAxis
unit = UnitVector(Vector=deplane.ZAxis)
multiplication = Multiplication(A=unit, B=B_2)
extr_2 = Extrude(Base=simplify(graft(extr)), Direction=simplify(graft(multiplication)))
E = ClusterOutput(extr_2)
